# Grasshopper definition 160307_Realtime Simulator_Predict Input Exporting.gh (Grasshopper 0.9.76)
# plug-ins: DIVA.ForGrasshopper, Python Interpreter

panel = Panel("C:\Users\RYAN\Documents\GitHub\Realtime_Sim\Python\160301_UDP_Colortizer_YZ.py")  # disabled
toggle = BooleanToggle(False)  # disabled

# ---- group: Call Python UDP Test, Doesn't Work!
python = PythonScript(active=toggle, pathPyUdp=panel)  # -> out, colortizerDataPath; disabled
# ---------- python: Python ----------
# -*- coding: utf-8 -*-
"""
Created on Thu Feb 18 00:04:53 2016

@author: Yan "Ryan" Zhang - ryanz@mit.edu
"""

if active: 
    from subprocess import call
    #call(["pythonw", pathPyUdp])
    call(["python", pathPyUdp])
    # the print in called python script will not work
    colortizerDataPath = "C:\Users\RYAN\Documents\GitHub\Realtime_Sim\Data\ColortizerData.txt"


"""
call os in gh, and pass input parameters, 
and use subprocess to call a python script with arguement, 
output to a file and have gh read csv. 
"""
# ---------- end python ----------

# ----
panel_2 = Panel(python.out)  # disabled
panel_3 = Panel(python.colortizerDataPath)  # disabled

# ---- group: original grid dimension
number_slider = Slider(34.331, range=1..100)

# ----
panel_4 = Panel("[end]central building height")  # disabled
panel_5 = Panel("[end]random seed number")  # disabled
panel_6 = Panel("[end]input node coordination")  # disabled

# ---- group: input method 1 - colortizer data
# Parsing Colortizer Data (Ryiadh 16x16)
panel_7 = Panel("C:\Users\RYAN\Documents\GitHub\Realtime_Sim\Data\ColortizerData.txt")

# ----
panel_8 = Panel("[start]central building height")  # disabled
panel_9 = Panel("[start]random seed number")  # disabled
panel_10 = Panel("[start]node reads difference")  # disabled
panel_11 = Panel("[end]node reads difference")  # disabled
panel_12 = Panel("[start]input node coordination")  # disabled
panel_13 = Panel("111")  # disabled
pipeline = GeometryPipeline(
    GroupByLayer=False,
    GroupByType=False,
    IncludeHidden=True,
    IncludeLocked=True,
    LayerFilter="CityScopeTableSim01",
    NameFilter="*",
    TypeFilter=1073741848)
panel_14 = Panel(",")  # disabled

# ---- group: grid size
number_slider_2 = Slider(5, range=1..19)  # disabled
number_slider_3 = Slider(5, range=1..19)  # disabled

# ---- group: grid dimension
# Parametric Modelling
number_slider_4 = Slider(34.331, range=1..100)  # disabled

# ---- group: building dimension
number_slider_5 = Slider(32.578, range=1..100)  # disabled

# ---- group: building heights
number_slider_6 = Slider(0.1, range=0.1..100)  # disabled
number_slider_7 = Slider(50, range=1..100)  # disabled
number_slider_8 = Slider(25, range=1..100)  # disabled
number_slider_9 = Slider(80, range=1..100)  # disabled

# ---- group: heightListID
# 1, 3
number_slider_10 = Slider(1, range=0..3)  # disabled

# ---- group: randam seed for context
# 0, 10, 20, 50
number_slider_11 = Slider(17983, range=0..20000)  # disabled

# ----
# Predict
toggle_2 = BooleanToggle(True)  # disabled
panel_15 = Panel("C:\Users\RYAN\Documents\GitHub\Realtime_Sim\Python\predictWithLR_YZ.py")  # disabled
srf = Surface(<surface referenced from the Rhino model>)
number_slider_12 = Slider(5465, range=0..5465)  # disabled

# ---- group: grid size
number_slider_13 = Slider(10.62, range=0..100)

# ----
# data1: 0 to 5465
# data2: 1 to 4500
number_slider_14 = Slider(4500, range=1..4500)  # disabled

# ---- group: building heights
number_slider_15 = Slider(0.1, range=0.1..100)
# 0, 10, 20, 50
number_slider_16 = Slider(50, range=1..100)
number_slider_17 = Slider(25, range=1..100)
# data1: 0 to 5465
# data2: 1 to 4500
number_slider_18 = Slider(80, range=1..100)

# ---- group: randam seed for context
number_slider_19 = Slider(17983, range=0..20000)

# ----
number_slider_20 = Slider(0, range=0..100)

# ---- group: input method 2 - rhino model
brep = Brep(pipeline)

# ----
number_slider_21 = Slider(5465, range=0..5465)
number_slider_22 = Slider(4500, range=1..4500)
bbox = BoundingBox(Content=srf, Plane=PlaneXY(0, 0, 0))  # -> Box, Box_2
neg = Negative(Value=number_slider_13)
merge = Merge(Data1=number_slider_6, Data2=number_slider_8, Data3=number_slider_7, Data4=number_slider_9)  # disabled
panel_16 = Panel("int((x+1)/2)")  # disabled
int = Integer(number_slider_10)  # disabled
int_2 = Integer(number_slider_11)  # disabled
int_3 = Integer(int_2)  # disabled

# ---- group: new grid size ratio
division = Division(A=number_slider_13, B=number_slider)

# ----
mesh = MeshBrep(
    Brep=brep,
    Settings={GridMaxCount=0, GridMinCount=16, JaggedSeams=False, MaxEdgeLength=0, MinEdgeLength=0.0001, MinTolerance=0, Refine=True, RefineAngle=0, RelativeTolerance=0.65, SimplePlanes=True, Tolerance=0})
txt = Text(flatten(int_3))  # disabled
txt_2 = Text(flatten(panel_13))  # disabled
box_corners = BoxCorners(Box=bbox.Box)  # -> CornerA, CornerB, CornerC, CornerD, CornerE, CornerF, CornerG, CornerH
merge_2 = Merge(Data1=number_slider_15, Data2=number_slider_17, Data3=number_slider_16, Data4=number_slider_18)
int_4 = Integer(number_slider_19)
recgrid = Rectangular(Plane=PlaneXY(0, 0, 0), SizeX=number_slider_4, SizeY=number_slider_4, ExtentX=number_slider_2, ExtentY=number_slider_3)  # -> Cells, Points; disabled
dom = ConstructDomain(DomainStart=number_slider_20, DomainEnd=number_slider_13)
dom_2 = ConstructDomain(DomainStart=number_slider_20, DomainEnd=neg)

# ---- group: colortizer data
file = ReadFile(File=panel_7, PerLineParse=True)

# ----
item = ListItem(List=merge, Index=int, Wrap=False)  # disabled
num = Number(item)  # disabled
txt_3 = Text(flatten(num))  # disabled
mjoin = MeshJoin(Meshes=mesh)

# ---- group: colortizer orgin
pt = Point(box_corners.CornerD)

# ----
# temp blocks
xy = XYPlane(Origin=pt)
end = EndPoints(Curve=recgrid.Cells)  # -> Start, End; disabled
split = SplitList(List=file, Index=1)  # -> ListA, ListB
pshift = ShiftPaths(Data=end.Start, Offset=-1)  # disabled
lng = ListLength(List=pshift)  # disabled
eval = Evaluate(F=panel_16, x=lng)  # disabled
subtraction = Subtraction(A=eval, B=2)  # disabled

unit_width = Slider(5, range=0..10)
unit_height = Slider(5, range=0..10)

dom_3 = ConstructDomain(DomainStart=0, DomainEnd=subtraction)  # disabled
split_2 = TextSplit(Text=split.ListA, Separators="\t")
split_3 = TextSplit(Text=split.ListB, Separators="\t")
subtraction_2 = Subtraction(A=lng, B=1)  # disabled
lng_2 = ListLength(List=merge)  # disabled
addition = Addition(A=subtraction, B=1)  # disabled
subset = SubList(List=pshift, Domain=dom_3, Wrap=False)  # -> List, Index; disabled
pshift_2 = ShiftPaths(Data=split_3, Offset=1)
pshift_3 = ShiftPaths(Data=split_2, Offset=1)
dom_4 = ConstructDomain(DomainStart=eval, DomainEnd=subtraction_2)  # disabled
subtraction_3 = Subtraction(A=lng_2, B=1)  # disabled
item_2 = ListItem(List=pshift, Index=addition, Wrap=True)  # disabled
pshift_4 = ShiftPaths(Data=pshift_2, Offset=1)
subset_2 = SubList(List=pshift, Domain=dom_4, Wrap=False)  # -> List, Index; disabled
pshift_5 = ShiftPaths(Data=pshift_3, Offset=1)
division_2 = Division(A=number_slider_13, B=2)
division_3 = Division(A=number_slider_13, B=2)
dom_5 = ConstructDomain(DomainStart=0, DomainEnd=subtraction_3)  # disabled
multiplication = Multiplication(A=unit_width, B=division)
multiplication_2 = Multiplication(A=unit_height, B=division)
number_slider_23 = Slider(0.1, range=0.1..100)  # disabled
merge_3 = Merge(Data1=subset.List, Data2=subset_2.List)  # disabled
int_5 = Integer(pshift_4)
txt_4 = Text(pshift_5)
Z = UnitZ(Factor=1)
num_2 = Number(multiplication)
num_3 = Number(multiplication_2)
panel_17 = Panel(txt_4)
panel_18 = Panel(int_5)
lng_3 = ListLength(List=merge_3)  # disabled
random = Random(Range=Domain(0, 1), Number=lng_3, Seed=int_2)  # disabled
graph = GraphMapper(
    random,
    x0=0,
    x1=1,
    y0=0,
    y1=1,
    container_name="Bezier",
    cpx=[0, 0.5129005909, 1, 1],
    cpy=[0, 0.00346583128, 0.3901748657, 1])  # disabled
remap = RemapNumbers(Value=graph, Source=Domain(0, 1), Target=dom_5)  # -> Mapped, Clipped; disabled
number_slider_24 = Slider(300, range=0..1000)  # disabled

# ---- group: starting pt (except centeral one)
pt_2 = Point(merge_3)  # disabled

# ---- group: centeral starting pt
pt_3 = Point(item_2)  # disabled

# ----
int_6 = Integer(remap.Mapped)  # disabled
xy_2 = XYPlane(Origin=pt_3)  # disabled
xy_3 = XYPlane(Origin=pt_2)  # disabled
dom_6 = ConstructDomain(DomainStart=0, DomainEnd=number_slider_23)  # disabled
item_3 = ListItem(List=merge, Index=int_6, Wrap=True)  # disabled
neg_2 = Negative(Value=number_slider_24)  # disabled
panel_19 = Panel("C:\Users\RYAN\Documents\GitHub\Realtime_Sim\Data\Xtest.txt")  # disabled
dom_7 = ConstructDomain(DomainStart=0, DomainEnd=number_slider_5)  # disabled

# ---- group: sticky["blnInitiated"]
python_2 = PythonScript()  # -> out, blnInitiated
# ---------- python_2: Python ----------
import scriptcontext as sc

sc.sticky["blnInitiated"] = False
blnInitiated = sc.sticky["blnInitiated"]
# ---------- end python_2 ----------

# ----
dom_8 = ConstructDomain(DomainStart=0, DomainEnd=item_3)  # disabled
dom_9 = ConstructDomain(DomainStart=0, DomainEnd=item)  # disabled
box = DomainBox(Base=xy_2, X=dom_7, Y=dom_7, Z=dom_6)  # disabled
dom_10 = ConstructDomain(DomainStart=neg_2, DomainEnd=number_slider_24)  # disabled
number_slider_25 = Slider(43, range=0..1000)  # disabled
box_2 = DomainBox(Base=xy_3, X=dom_7, Y=dom_7, Z=dom_8)  # disabled
number_slider_26 = Slider(1000, range=0..1000)  # disabled
box_3 = DomainBox(Base=xy_2, X=dom_7, Y=dom_7, Z=dom_9)  # disabled

# ---- group: center blank replacement
brep_2 = Brep(box)  # disabled

# ----
panel_20 = Panel(python_2.blnInitiated)
panel_21 = Panel(python_2.out)
toggle_activate = BooleanToggle(True)  # disabled
merge_4 = Merge(
    Data1=ColourSwatch(SwatchColor=RGBA(0, 0, 0, 0)),
    Data2=ColourSwatch(SwatchColor=RGB(0, 128, 128)),
    Data3=ColourSwatch(SwatchColor=RGB(128, 87, 0)),
    Data4=ColourSwatch(SwatchColor=RGB(30, 128, 0)))
item_4 = ListItem(List=panel_18, Index="3", Wrap=False)
item_5 = ListItem(List=panel_18, Index="0", Wrap=False)
item_6 = ListItem(List=panel_18, Index="1", Wrap=False)
item_7 = ListItem(List=panel_18, Index="2", Wrap=False)
X = UnitX(Factor=number_slider_26)  # disabled
nodes_offset_out = Slider(0.1, range=0..1)

# ---- group: rotation
pshift_6 = ShiftPaths(Data=item_4, Offset=-1)

# ---- group: module id
pshift_7 = ShiftPaths(Data=item_5, Offset=-1)

int_7 = Integer(pshift_7)

# ----
lng_4 = ListLength(List=int_7)
larger = LargerThan(FirstNumber=int_7, SecondNumber="2")  # -> LargerThan, OrEqualTo
repeat = RepeatData(Data="-1", Length=lng_4)

# ---- group: filter id larger than 2
p_n_c = PickNChoose(Pattern=larger.LargerThan, Stream0=int_7, Stream1=repeat)

# ---- group: id to selection
addition_2 = Addition(A=p_n_c, B="1")

# ----
item_8 = ListItem(List=merge_2, Index=addition_2, Wrap=False)
multiplication_3 = Multiplication(A=item_8, B=division)

# ---- group: height from colotizer
num_4 = Number(multiplication_3)

# ----
panel_22 = Panel(num_4)
item_9 = ListItem(List=merge_4, Index=addition_2, Wrap=False)

# ---- group: x
pshift_8 = ShiftPaths(Data=item_6, Offset=-1)

# ----
multiplication_4 = Multiplication(A=pshift_8, B=number_slider_13)
addition_3 = Addition(A=multiplication_4, B=division_2)
X_2 = UnitX(Factor=multiplication_4)

# ---- group: y
pshift_9 = ShiftPaths(Data=item_7, Offset=-1)

# ----
multiplication_5 = Multiplication(A=pshift_9, B=neg)
subtraction_4 = Subtraction(A=multiplication_5, B=division_3)
pt_4 = PointOriented(BasePlane=xy, UComponent=addition_3, VComponent=subtraction_4, WComponent=0)
line = LineSDL(Start=pt_4, Direction=Z, Length="100")
mcx = MeshCurve(Mesh=mjoin, Curve=line)  # -> Points, Faces
pdecon = Deconstruct(Point=mcx.Points)  # -> XComponent, YComponent, ZComponent
maxnum = MaxNum(num=pdecon.ZComponent)
pshift_10 = ShiftPaths(Data=maxnum, Offset=-1)

# ---- group: height from rhino model
num_5 = Number(pshift_10)

# ----
panel_23 = Panel(num_5)

# ---- group: height!
num_6 = Number(panel_23)

# ----
dom_11 = ConstructDomain(DomainStart=number_slider_20, DomainEnd=num_6)
box_4 = DomainBox(Base=xy, X=dom, Y=dom_2, Z=dom_11)
move = Move(Geometry=box_4, Motion=X_2)  # -> Geometry, Transform
Y = UnitY(Factor=multiplication_5)
move_2 = Move(Geometry=move.Geometry, Motion=Y)  # -> Geometry, Transform

# ---- group: Parsed volume
box_5 = Box(move_2.Geometry)

box_6 = Box(box_5)

# ----
# Nodes
removebreptoporbottom = RemoveBrepTopOrBottom(brep=box_6, bool=True)  # disabled
srf_2 = Surface(removebreptoporbottom)

# ---- group: node base srf
brep_3 = Brep(srf_2)

# ----
srf_3 = Surface(reparameterize(flatten(brep_3)))

# ---- group: glass srf
srf_4 = Surface(reparameterize(graft(srf_3)))

# ----
dim = Dimensions(Surface=srf_4)  # -> UDimension, VDimension
area = Area(Geometry=srf_3)  # -> Area, Centroid
division_4 = Division(A=dim.VDimension, B=num_3)
division_5 = Division(A=dim.UDimension, B=num_2)
divide = DivideDomain²(Domain=srf_4, UCount=division_5, VCount=division_4)
pdecon_2 = Deconstruct(Point=area.Centroid)  # -> XComponent, YComponent, ZComponent
subsrf = Isotrim(Surface=srf_4, Domain=divide)

# ---- group: input building height
num_7 = Number(pdecon_2.ZComponent)

# ---- group: result geo
srf_5 = Surface(reparameterize(flatten(subsrf)))

# ----
item_10 = ListItem(List=box_5, Index=number_slider_25, Wrap=True)  # disabled
evalsrf = EvaluateSurface(Surface=srf_5, Point=Point(0.5, 0.5, 0))  # -> Point, Normal, Frame
join = BrepJoin(Breps=flatten(brep_3))  # -> Breps, Closed
mesh_2 = MeshBrep(
    Brep=join.Breps,
    Settings={GridMaxCount=0, GridMinCount=16, JaggedSeams=False, MaxEdgeLength=0, MinEdgeLength=0.0001, MinTolerance=0, Refine=True, RefineAngle=0, RelativeTolerance=0.65, SimplePlanes=True, Tolerance=0})

# ---- group: current and last heights
python_3 = PythonScript(x=num_6)  # -> out, currentHeights, lastHeights, blnInitiated, triger; inputs x: list
# ---------- python_3: Python ----------
import scriptcontext as sc

if sc.sticky["blnInitiated"] == False: 
    sc.sticky["blnInitiated"] = True
    sc.sticky["lastHeights"] = x
    sc.sticky["currentHeights"] = x
else: 
    sc.sticky["lastHeights"] = sc.sticky["currentHeights"]
    sc.sticky["currentHeights"] = x


blnInitiated = sc.sticky["blnInitiated"]
lastHeights = sc.sticky["lastHeights"]
currentHeights = sc.sticky["currentHeights"]

if not lastHeights == currentHeights:
    triger = True
else:
    triger = False
# ---------- end python_3 ----------

# ---- group: compare get surrounding and predict
python_4 = PythonScript(triger=python_3.triger)  # -> out, a
# ---------- python_4: Python ----------
import scriptcontext as sc

# given x step and y step return height id
def xy2n(x,y):
    n = y + (15 - x) * 15
    return n

if triger and sc.sticky["blnInitiated"] == True:
    
    currentHeights = sc.sticky["currentHeights"]
    lastHeights = sc.sticky["lastHeights"]
    diffs = []
    for i in range(0, len(currentHeights)):
        hc = currentHeights[i]
        hl = lastHeights[i]
        if not hc == hl:
            diffs.append(i)
    
    if len(diffs) > 0:
        
        xSteps = sc.sticky["xSteps"]
        ySteps = sc.sticky["ySteps"]
        for diff in diffs:
            print "differet module found! at number: ", diff
            print "x step = ", xSteps[diff]
            print "y step = ", ySteps[diff]
            print "lastHeights = ", lastHeights[diff]
            print "currentHeights = ", currentHeights[diff]
        
        # do the first diff first, TODO: loop each diff later
        diff = diffs[0]
        xs = range(int(xSteps[diff])-2,int(xSteps[diff])+2+1)
        ys = range(int(ySteps[diff])-2,int(ySteps[diff])+2+1)
        
        # bufferMatrix: 5 by 5 matrix (list of list), element is a list of
        # [x, y, valid(in bound), n(order in data list), height] 
        # if not valid, height = 0.030934
        
        # initiate bufferMatrix
        bufferMatrix = [[[],[],[],[],[]],
                        [[],[],[],[],[]],
                        [[],[],[],[],[]],
                        [[],[],[],[],[]],
                        [[],[],[],[],[]]]
        #for i in range(5): tempRow.append([0,0,0,0,0]) #doesn't work!
        
        # fill bufferMatrix
        for j in range(5):
            for i in range(5):
                #print "i: ", i, "; j: ", j
                x = xs[i]
                y = ys[j]
                #print "x: ", x, "; y: ", y
                if x >= 0 and x <= 15 and y >= 0 and y <= 15:
                    v = 1 #valid/in bound = 1, not valid = 0
                    n = xy2n(x,y)
                    h = lastHeights[n]
                else: 
                    v = 0 #not valid
                    n = -1 #not valid
                    h = 0.030934
                bufferMatrix[j][i] = [x,y,v,n,h]
        print bufferMatrix
# ---------- end python_4 ----------

# ----
panel_24 = Panel(python_4.out)
mjoin_2 = MeshJoin(Meshes=mesh_2)
meshcp = MeshClosestPoint(Point=evalsrf.Point, Mesh=mjoin_2)  # -> Point, Index, Parameter
meval = MeshEval(Mesh=mjoin_2, Parameter=meshcp.Parameter)  # -> Point, Normal, Colour
panel_25 = Panel(pshift_8)
panel_26 = Panel(pshift_7)
panel_27 = Panel(pshift_9)
panel_28 = Panel(pshift_6)
swatch = ColourSwatch(SwatchColor=RGBA(191, 191, 191, 75))  # disabled
swatch_2 = ColourSwatch(SwatchColor=RGBA(171, 190, 255, 150))  # disabled

# ---- group: context geometry
brep_4 = Brep(box_2)  # disabled

# ----
preview = CustomPreview(Geometry=box_5, Shader=item_9)

# ---- group: center building block geometry
brep_5 = Brep(box_3)  # disabled

# ----
amp = Amplitude(Vector=meval.Normal, Amplitude=nodes_offset_out)
panel_29 = Panel(python_3.blnInitiated)
panel_30 = Panel(python_3.lastHeights)
move_3 = Move(Geometry=evalsrf.Point, Motion=amp)  # -> Geometry, Transform
panel_31 = Panel(python_3.out)
removebreptoporbottom_2 = RemoveBrepTopOrBottom(brep=brep_4, bool=True)  # disabled
preview_2 = CustomPreview(Geometry=removebreptoporbottom_2, Shader=swatch)  # disabled
removebreptoporbottom_3 = RemoveBrepTopOrBottom(brep=brep_5, bool=True)  # disabled
preview_3 = CustomPreview(Geometry=removebreptoporbottom_3, Shader=swatch_2)  # disabled

# ---- group: testing nodes
pt_5 = Point(move_3.Geometry)

# ----
panel_32 = Panel(python_3.currentHeights)

# ---- group: sticky rotations
python_5 = PythonScript(x=panel_28)  # -> out, rotations; inputs x: list
# ---------- python_5: Python ----------
import scriptcontext as sc

sc.sticky["rotations"] = x

rotations = sc.sticky["rotations"]
# ---------- end python_5 ----------

# ---- group: sticky y steps
python_6 = PythonScript(x=panel_27)  # -> out, ySteps; inputs x: list
# ---------- python_6: Python ----------
import scriptcontext as sc

sc.sticky["ySteps"] = x

ySteps = sc.sticky["ySteps"]
# ---------- end python_6 ----------

# ---- group: sticky moduleIDs
python_7 = PythonScript(x=panel_26)  # -> out, moduleIDs; inputs x: list
# ---------- python_7: Python ----------
import scriptcontext as sc

sc.sticky["moduleIDs"] = x

moduleIDs = sc.sticky["moduleIDs"]
# ---------- end python_7 ----------

# ---- group: sticky x steps
python_8 = PythonScript(x=panel_25)  # -> out, xSteps; inputs x: list
# ---------- python_8: Python ----------
import scriptcontext as sc

sc.sticky["xSteps"] = x

xSteps = sc.sticky["xSteps"]
# ---------- end python_8 ----------

# ----
panel_33 = Panel(python_5.rotations)
panel_34 = Panel(python_5.out)
panel_35 = Panel(python_6.ySteps)
number_slider_27 = Slider(1000, range=0..1000)  # disabled
panel_36 = Panel(python_6.out)
panel_37 = Panel(python_8.xSteps)
panel_38 = Panel(python_8.out)
panel_39 = Panel(python_7.moduleIDs)
panel_40 = Panel(python_7.out)
neg_3 = Negative(Value=number_slider_27)  # disabled
X_3 = UnitX(Factor=neg_3)  # disabled
X_4 = UnitX(Factor=neg_3)  # disabled
move_4 = Move(Geometry=brep_5, Motion=X_3)  # -> Geometry, Transform; disabled
panel_41 = Panel("PROJECT_NAME")  # disabled

# ---- group: ground
brep_6 = Brep()  # disabled
M = Material(Geometry=brep_6, Geometry_2=brep_6, Material="GenericCeiling_80")  # -> GeometryWithMaterialAssigned, GeometryWithMaterialAssigned_2; disabled

# ---- group: glass
brep_7 = Brep()  # disabled
M_2 = Material(Geometry=brep_7, Geometry_2=brep_7, Material="GenericCeiling_80")  # -> GeometryWithMaterialAssigned, GeometryWithMaterialAssigned_2; disabled

# ---- group: slab
brep_8 = Brep(box_6)  # disabled
M_3 = Material(Geometry=brep_8, Geometry_2=brep_8, Material="GenericCeiling_80")  # -> GeometryWithMaterialAssigned, GeometryWithMaterialAssigned_2; disabled

# ----
move_5 = Move(Geometry=brep_4, Motion=X_4)  # -> Geometry, Transform; disabled

# ---- group: can not be button!
# Analysis (with Central Building)
toggle_3 = BooleanToggle(False)  # disabled

# ----
preview_4 = CustomPreview(Geometry=move_4.Geometry, Shader=swatch_2)  # disabled
preview_5 = CustomPreview(Geometry=move_5.Geometry, Shader=swatch)  # disabled
# default: -ab 2 -ad 1000 -as 20 -ar 300 -aa 0.1
# low1: -ab 2 -ad 600 -as 12 -ar 200 -aa 0.1
# low2: -ab 2 -ad 450 -as 9 -ar 150 -aa 0.1
# low3: -ab 2 -ad 300 -as 6 -ar 100 -aa 0.1
diva_daylight = DIVADaylightAnalysisForGH(
    ProjectName=panel_41,
    GeometryWithRadianceMaterialReference=[M_2.GeometryWithMaterialAssigned_2, M_3.GeometryWithMaterialAssigned_2, M.GeometryWithMaterialAssigned_2],
    AnalysisNodes=pt_5,
    WriteOnly=False,
    RunSimulation=toggle_3,
    ProjectName_2=panel_41,
    GeometryWithRadianceMaterialReference_2=[M_2.GeometryWithMaterialAssigned_2, M_3.GeometryWithMaterialAssigned_2, M.GeometryWithMaterialAssigned_2],
    AnalysisNodes_2=pt_5,
    WriteOnly_2=False,
    RunSimulation_2=toggle_3,
    Climate_Occ=0,
    Climate_RadParam="-ab 2 -ad 1000 -as 20 -ar 300 -aa 0.1",
    DF_RadParam="-ab 2 -ad 1000 -as 20 -ar 300 -aa 0.1",
    DimIrr=200,
    DirIrr=800,
    Ill_RadParam="-ab 2 -ad 1000 -as 20 -ar 300 -aa 0.1",
    Insol_CustomDates=False,
    Insol_EndDay=30,
    Insol_EndMonth=11,
    Insol_RadParam="-ab 2 -ad 300 -as 6 -ar 100 -aa 0.1",
    Insol_StartDay=0,
    Insol_StartMonth=0,
    Insol_Vis_RadParam="-ab 2 -ad 1000 -as 20 -ar 300 -aa 0.1",
    InsolationPeriod=0,
    Irr_FC_legend_max="auto",
    Light_Operation=3,
    Lighting_Param="-W 250.0 -Set 300 -Loss 20 -Standby 0.0",
    Location="USA_MA_Boston-Logan.Intl.AP.725090_TMY3.epw",
    Lum_FC_legend_max="auto",
    MDH_Input=False,
    MinIll=300,
    OutputStates=True,
    Quality=0,
    Rhino_Include=False,
    SimulationType=0,
    SkyCond=0,
    StartDay=20,
    StartHour=12,
    StartMonth=5,
    Vis_RadParam="-ps 8 -pt .15 -pj .6 -dj 0 -ds .5 -dt .5 -dc .25 -dr 0 -dp 64 -st .85 -ab 2 -aa .25 -ar 16 -ad 512 -as 128 -lr 4 -lw .05 -av 0 0 0",
    X_Resolution=600,
    Y_Resolution=400)  # -> OutputMessage, MetricSolarIrradiation, OutputMessage_2, MetricSolarIrradiation_2; disabled
number_slider_28 = Slider(1000, range=0..1000)  # disabled
X_5 = UnitX(Factor=number_slider_28)  # disabled
X_6 = UnitX(Factor=number_slider_28)  # disabled
move_6 = Move(Geometry=removebreptoporbottom_3, Motion=X_5)  # -> Geometry, Transform; disabled

# ---- group: result with ground
num_8 = Number(diva_daylight.MetricSolarIrradiation_2)  # disabled

# ---- group: Internalise to record the result
num_9 = Number([993, 1025, 1057, 1126, 1170, 1213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])

# ----
move_7 = Move(Geometry=removebreptoporbottom_2, Motion=X_6)  # -> Geometry, Transform; disabled
bnd = Bounds(Numbers=num_9)
preview_6 = CustomPreview(Geometry=move_6.Geometry, Shader=swatch_2)
preview_7 = CustomPreview(Geometry=move_7.Geometry, Shader=swatch)
remap_2 = RemapNumbers(Value=num_9, Source=bnd, Target=Domain(0, 1))  # -> Mapped, Clipped
gradient = Gradient(
    LowerLimit=0,
    UpperLimit=1,
    Parameter=remap_2.Mapped,
    stops=[0: RGB(0, 128, 0), 0.5: RGB(255, 255, 0), 1: RGB(255, 0, 0)])

# ---- group: node base srf
# Nodes
brep_9 = Brep([brep_4, brep_5])  # disabled

# ----
unit_width_2 = Slider(5, range=0..10)  # disabled
unit_height_2 = Slider(5, range=0..10)  # disabled

unit_width_3 = Slider(1.5, range=0..10)  # disabled
unit_height_3 = Slider(4.2, range=0..10)  # disabled

# ---- group: result
preview_8 = CustomPreview(Geometry=srf_5, Shader=gradient)

# ----
extractbreptoporbottom = ExtractBrepTopOrBottom(brep=brep_9, bool=True)  # disabled
debrep = DeconstructBrep(Brep=brep_9)  # -> Faces, Edges, Vertices; disabled
srf_6 = Surface(reparameterize(flatten(extractbreptoporbottom)))  # disabled
num_10 = Number(unit_width_2)  # disabled
num_11 = Number(unit_height_2)  # disabled

# ---- group: glass srf
srf_7 = Surface(reparameterize(graft(srf_6)))  # disabled

# ----
dim_2 = Dimensions(Surface=srf_7)  # -> UDimension, VDimension; disabled
area_2 = Area(Geometry=srf_6)  # -> Area, Centroid; disabled
division_6 = Division(A=dim_2.VDimension, B=num_11)  # disabled
division_7 = Division(A=dim_2.UDimension, B=num_10)  # disabled
divide_2 = DivideDomain²(Domain=srf_7, UCount=division_7, VCount=division_6)  # disabled
pdecon_3 = Deconstruct(Point=area_2.Centroid)  # -> XComponent, YComponent, ZComponent; disabled
subsrf_2 = Isotrim(Surface=srf_7, Domain=divide_2)  # disabled

# ---- group: input building height
num_12 = Number(pdecon_3.ZComponent)  # disabled

# ---- group: result geo
srf_8 = Surface(reparameterize(flatten(subsrf_2)))  # disabled

# ----
move_8 = Move(Geometry=srf_8, Motion=X)  # -> Geometry, Transform; disabled
join_2 = BrepJoin(Breps=flatten(brep_9))  # -> Breps, Closed; disabled
area_3 = Area(Geometry=srf_8)  # -> Area, Centroid; disabled
nodes_offset_out_2 = Slider(0.1, range=0..1)  # disabled
mesh_3 = MeshBrep(
    Brep=join_2.Breps,
    Settings={GridMaxCount=0, GridMinCount=16, JaggedSeams=False, MaxEdgeLength=0, MinEdgeLength=0.0001, MinTolerance=0, Refine=True, RefineAngle=0, RelativeTolerance=0.65, SimplePlanes=True, Tolerance=0})  # disabled
mjoin_3 = MeshJoin(Meshes=mesh_3)  # disabled
meshcp_2 = MeshClosestPoint(Point=area_3.Centroid, Mesh=mjoin_3)  # -> Point, Index, Parameter; disabled
meval_2 = MeshEval(Mesh=mjoin_3, Parameter=meshcp_2.Parameter)  # -> Point, Normal, Colour; disabled
amp_2 = Amplitude(Vector=meval_2.Normal, Amplitude=nodes_offset_out_2)  # disabled
move_9 = Move(Geometry=area_3.Centroid, Motion=amp_2)  # -> Geometry, Transform; disabled

# ---- group: testing nodes
pt_6 = Point(move_9.Geometry)  # disabled

# Data Export
pt_7 = Point(pt_6)  # disabled

# ----
pdecon_4 = Deconstruct(Point=pt_7)  # -> XComponent, YComponent, ZComponent; disabled
subtraction_5 = Subtraction(A=pdecon_4.ZComponent, B=0.1)  # disabled
merge_5 = Merge(Data1=graft(pdecon_4.XComponent), Data2=graft(pdecon_4.YComponent), Data3=graft(subtraction_5))  # disabled
join_3 = TextJoin(Text=merge_5, Join=panel_14)  # disabled
pshift_11 = ShiftPaths(Data=join_3, Offset=-1)  # disabled
panel_42 = Panel(pshift_11)  # disabled
txt_5 = Text(flatten(panel_42))  # disabled
merge_6 = Merge(
    Data1=panel_8,
    Data2=txt_3,
    Data3=panel_4,
    Data4=panel_9,
    Data5=txt,
    Data6=panel_5,
    Data7=panel_12,
    Data8=txt_5,
    Data9=panel_6,
    Data10=panel_10,
    Data11=txt_2,
    Data12=panel_11)  # disabled

# ---- group: data to export
panel_43 = Panel(merge_6)  # disabled

# ---- group: write txt file
vb = VBScript(filePath=panel_19, data=panel_43, append=False, activate=toggle_activate)  # -> out, A; inputs data: list; disabled
# ---------- vb: VB ----------
    'Code by Victor Leung @ www.dreamationworks.com
    If activate Then

      Dim i As Integer
      Dim aryText(4) As String

      aryText(0) = "Mary WriteLine"
      aryText(1) = "Had"
      aryText(2) = "Another"
      aryText(3) = "Little"
      aryText(4) = "One"

      ' the data is appended to the file. If file doesnt exist, a new file is created
      Dim objWriter As New System.IO.StreamWriter(filePath, append)

      For i = 0 To data.Count - 1
        objWriter.WriteLine(data(i))
      Next

      objWriter.Close()

    End If

    If clearFile Then
      Dim objWriter As New System.IO.StreamWriter(filePath, False)
      objWriter.Close()
    End If
# ---------- end vb ----------

# ---- group: Call Predict Python Script
python_9 = PythonScript(active=toggle_2, trigger=vb.A, pathPyPredict=panel_15)  # -> out, predictionPath; disabled
# ---------- python_9: Python ----------
# -*- coding: utf-8 -*-
"""
Created on Thu Feb 18 00:04:53 2016

@author: RYAN
"""

#str01 = "x:"+str(x)+"; y:"+str(y)+"; z:"+str(z)
#print str01

if active: 
    from subprocess import call
    #call(["python", "C:\\Users\\RYAN\\Documents\\GitHub\\Realtime_Simulator\\Python\\\predictWithLR_YZ.py"])
    #print(pathPyPredict)
    call(["pythonw", pathPyPredict])
    # the print in called python script will not work
    predictionPath = "C:\Users\RYAN\Documents\GitHub\Realtime_Sim\Data\prediction.txt"


"""
call os in gh, and pass input parameters, 
and use subprocess to call a python script with arguement, 
output to a file and have gh read csv. 
"""
# ---------- end python_9 ----------

# ----
panel_44 = Panel(python_9.predictionPath)  # disabled
# Data File Visualize (difference)
panel_45 = Panel(panel_44)  # disabled

# ---- group: prediction.txt
file_2 = ReadFile(File=panel_45, PerLineParse=True)  # disabled

# ----
split_4 = TextSplit(Text=file_2, Separators=",")  # disabled
num_13 = Number(split_4)  # disabled
panel_46 = Panel(num_13)  # disabled

# ---- group: result difference
num_14 = Number(panel_46)  # disabled

# ----
bnd_2 = Bounds(Numbers=num_14)  # disabled
remap_3 = RemapNumbers(Value=num_14, Source=dom_10, Target=Domain(0, 1))  # -> Mapped, Clipped; disabled
gradient_2 = Gradient(
    LowerLimit=0,
    UpperLimit=1,
    Parameter=remap_3.Mapped,
    stops=[0: RGB(0, 128, 0), 0.5: RGB(255, 255, 0), 1: RGB(255, 0, 0)])  # disabled

# ---- group: result
preview_9 = CustomPreview(Geometry=move_8.Geometry, Shader=gradient_2)  # disabled

# ==== cluster RemoveBrepTopOrBottom
brep = ClusterInput()
bool = ClusterInput()
brep_2 = Brep(brep)
bool_2 = Boolean(bool)
num = Number(bool_2)
debrep = DeconstructBrep(Brep=brep_2)  # -> Faces, Edges, Vertices
subtraction = Subtraction(A=num, B=0.5)
multiplication = Multiplication(A=subtraction, B=2)
Z = UnitZ(Factor=multiplication)
area = Area(Geometry=debrep.Faces)  # -> Area, Centroid
srf_cp = SurfaceClosestPoint(Point=area.Centroid, Surface=debrep.Faces)  # -> Point, UVPoint, Distance
evalsrf = EvaluateSurface(Surface=debrep.Faces, Point=srf_cp.UVPoint)  # -> Point, Normal, Frame
angle = Angle(VectorA=evalsrf.Normal, VectorB=Z)  # -> Angle, Reflex
equals = Equality(FirstNumber=angle.Angle, SecondNumber=0)  # -> Equality, Inequality
dispatch = Dispatch(List=debrep.Faces, DispatchPattern=equals.Inequality)  # -> ListA, ListB
srf = Surface(dispatch.ListA)
join = BrepJoin(Breps=srf)  # -> Breps, Closed
pshift = ShiftPaths(Data=join.Breps, Offset=-1)
brep_3 = Brep(pshift)
brep_4 = ClusterOutput(brep_3)

# ==== cluster ExtractBrepTopOrBottom
brep = ClusterInput()
bool = ClusterInput()
brep_2 = Brep(brep)
bool_2 = Boolean(bool)
num = Number(bool_2)
debrep = DeconstructBrep(Brep=brep_2)  # -> Faces, Edges, Vertices
subtraction = Subtraction(A=num, B=0.5)
multiplication = Multiplication(A=subtraction, B=2)
Z = UnitZ(Factor=multiplication)
area = Area(Geometry=debrep.Faces)  # -> Area, Centroid
srf_cp = SurfaceClosestPoint(Point=area.Centroid, Surface=debrep.Faces)  # -> Point, UVPoint, Distance
evalsrf = EvaluateSurface(Surface=debrep.Faces, Point=srf_cp.UVPoint)  # -> Point, Normal, Frame
angle = Angle(VectorA=evalsrf.Normal, VectorB=Z)  # -> Angle, Reflex
equals = Equality(FirstNumber=angle.Angle, SecondNumber=0)  # -> Equality, Inequality
dispatch = Dispatch(List=debrep.Faces, DispatchPattern=equals.Equality)  # -> ListA, ListB
srf = Surface(dispatch.ListA)
srf_2 = ClusterOutput(srf)

# ==== cluster MaxNum
num = ClusterInput()
num_2 = Number(num)
bnd = Bounds(Numbers=num_2)
dedomain = DeconstructDomain(Domain=bnd)  # -> Start, End
equals = Equality(FirstNumber=num_2, SecondNumber=dedomain.End)  # -> Equality, Inequality
dispatch = Dispatch(List=num_2, DispatchPattern=equals.Equality)  # -> ListA, ListB
num_3 = Number(dispatch.ListA)
num_4 = ClusterOutput(num_3)
